# Grasshopper definition intercropping.gh (Grasshopper 1.0.7)

number_slider = Slider(5000, range=0..5000)
number_slider_2 = Slider(800, range=0..1000)
number_slider_3 = Slider(0, range=0..5000)
number_slider_4 = Slider(0, range=0..5000)
srf = Surface(<surface referenced from the Rhino model>)  # disabled
number_slider_5 = Slider(300, range=0..400)
number_slider_6 = Slider(150, range=0..400)
_0_800 = ConstructPoint(XCoordinate=0, YCoordinate=number_slider_2, ZCoordinate=0)
construct_point = ConstructPoint(XCoordinate=number_slider_4, YCoordinate=number_slider_3, ZCoordinate=0)
construct_point_2 = ConstructPoint(XCoordinate=number_slider, YCoordinate=0, ZCoordinate=0)
construct_point_3 = ConstructPoint(XCoordinate=number_slider, YCoordinate=number_slider_2, ZCoordinate=0)
ln = Line(StartPoint=construct_point, EndPoint=_0_800)
ln_2 = Line(StartPoint=construct_point_2, EndPoint=construct_point)
ln_3 = Line(StartPoint=construct_point_3, EndPoint=construct_point_2)
ln_4 = Line(StartPoint=_0_800, EndPoint=construct_point_3)
addition = Addition(A=number_slider_5, B=number_slider_6)
dom = ConstructDomain(DomainStart=number_slider_4, DomainEnd=number_slider_2)
dom_2 = ConstructDomain(DomainStart=number_slider_3, DomainEnd=number_slider)
bnd = Bounds(Numbers=[number_slider_2, number_slider_4])
crv = Curve([ln, ln_2])
cluster = Cluster()  # disabled
panel = Panel(bnd)
offset = OffsetCurve(Curve=crv, Distance=number_slider_5, Plane=PlaneXY(0, 0, 0), Corners=1)  # -> flatten(Curve)
dom² = ConstructDomain²(DomainU=Domain(0, 1), DomainV=Domain(0, 1))
item = ListItem(List=offset, Index=0, Wrap=True)  # -> Item1, Item, Item1_2
llx = LineLine(Line1=item.Item, Line2=item.Item1_2)  # -> ParamA, ParamB, PointA, PointB
cir = Circle(Plane=llx.PointA, Radius=number_slider_5)
crvdom = CurveDomain(Curve=cir)  # -> Curve, Domain
panel_2 = Panel(crvdom.Domain)
crv_2 = Curve([crvdom.Curve, ln_2, cir])
offset_2 = OffsetCurve(Curve=crv_2, Distance=number_slider_6, Plane=PlaneXY(0, 0, 0), Corners=1)  # -> flatten(Curve)
item_2 = ListItem(List=offset_2, Index=0, Wrap=True)  # -> Item1, Item, Item1_2
clx = CurveLine(Curve=item_2.Item, Line=item_2.Item1_2)  # -> Points, Params, Count
shift = ShiftList(List=clx.Points, Shift=Slider(1, range=0..10), Wrap=True)
item_3 = ListItem(List=shift, Index=0, Wrap=True)
crv_3 = Curve(flatten([cir, ln_4]))
panel_3 = Panel(item_3)
offset_3 = OffsetCurve(Curve=crv_3, Distance=number_slider_6, Plane=PlaneXY(0, 0, 0), Corners=1)  # -> flatten(Curve)
item_4 = ListItem(List=offset_3, Index=0, Wrap=True)  # -> Item1, Item, Item1_2
clx_2 = CurveLine(Curve=item_4.Item, Line=item_4.Item1_2)  # -> Points, Params, Count
shift_2 = ShiftList(List=clx_2.Points, Shift=Slider(0, range=0..10), Wrap=True)
item_5 = ListItem(List=shift_2, Index=0, Wrap=True)
cir_2 = Circle(Plane=item_5, Radius=number_slider_6)
cir_3 = Circle(Plane=item_3, Radius=number_slider_6)
crv_4 = Curve(flatten([cir_3, cir_2]))
offset_4 = OffsetCurve(Curve=crv_4, Distance=number_slider_5, Plane=PlaneXY(0, 0, 0), Corners=1)  # -> flatten(Curve)
crvdom_2 = CurveDomain(Curve=offset_4, Domain=bnd)  # -> Curve, Domain
item_6 = ListItem(List=crvdom_2.Curve, Index=0, Wrap=True)  # -> Item1, Item, Item1_2
panel_4 = Panel(crvdom_2.Domain)
rint = RegionIntersection(CurvesA=item_6.Item, CurvesB=item_6.Item1_2)
divide = DivideCurve(Curve=rint, Count=Slider(0, range=0..100), Kinks=rint)  # -> Points, Tangents, Parameters
shift_3 = ShiftList(List=divide.Points, Shift=Slider(0, range=0..10), Wrap=True)
item_7 = ListItem(List=shift_3, Index=0, Wrap=True)
panel_5 = Panel(item_7)
panel_6 = Panel(divide.Points)
cir_4 = Circle(Plane=item_7, Radius=number_slider_5)

# ==== cluster Cluster
number_slider = Slider(37, range=0..100)
pt = Point(Point(0, 0, 0))
polygon = Polygon(Plane=pt, Radius=Slider(10, range=0..10), Segments=number_slider, FilletRadius=0)  # -> Polygon, Length
explode = Explode(Curve=polygon.Polygon, Recursive=True)  # -> Segments, Vertices
extr = ExtrudePoint(Base=explode.Segments, Point=pt)
div = DivideDomain(Domain=Domain(0, 1), Count=number_slider)
debrep = DeconstructBrep(Brep=extr)  # -> Faces, Edges, Vertices
dedomain = DeconstructDomain(Domain=div)  # -> Start, End
hsl = ColourHSL(Alpha=1, Hue=dedomain.Start, Saturation=1, Luminance=0.5)
preview = CustomPreview(Geometry=flatten(debrep.Faces), Material=hsl)
